% Simulink data dictionary control_system_data.sldd

D_gain = Simulink.Parameter(0)
I_gain = Simulink.Parameter(0.11)
N_gain = Simulink.Parameter(14.9)
P_gain = Simulink.Parameter(0.077)
plant_den = Simulink.Parameter([0.0032 1.40192 126328.48 39438400 0])
plant_num = Simulink.Parameter([0 0 0 0 3943840000])
ts = Simulink.Parameter(0.01)